# Grasshopper definition building generator.gh (Grasshopper 1.0.8)

inset_bay_count_length = Slider(2, range=1..5)
baycounty = Slider(4, range=1..7)
column_width = Slider(1.6, range=1.6..6)
arch_width = Slider(2.66, range=2..5)
wall_thickness = Slider(0.5, range=0.3..0.5)
baycountx = Slider(3, range=1..4)
inset_bay_count_width = Slider(1, range=1..3)
footprint = ValueList({"rectangle": "Rectangle", "L-shape": "L", "C-shape": "C", "courtyard": "Courtyard"}, selected="courtyard")
column_height = Slider(2.82, range=1.8..3)
expression = Expression(x=baycounty, y=column_width, z=arch_width, u=wall_thickness, Expression="x * (y+z)+ 2*u")
expression_2 = Expression(x=baycountx, y=column_width, z=arch_width, u=wall_thickness, Expression="x * (y+z)+ 2*u")
expression_3 = Expression(x=arch_width, y=column_height, Expression="x/2+y+0.5")
expression_4 = Expression(x=inset_bay_count_length, y=column_width, z=arch_width, u=wall_thickness, Expression="x * (y+z)+ u/2")
expression_5 = Expression(x=inset_bay_count_width, y=column_width, z=arch_width, u=wall_thickness, Expression="x * (y+z)+ u/2")

floor1type = ValueList({"arcade", "colonnade", "solid"}, selected="arcade")
storey = Slider(1, range=1..3)
rooftype = ValueList({"flat", "gable", "pointed"}, selected="flat")
floor_edge_offset = Slider(0.25, range=0.1..0.25)
floor_thickness = Slider(0.44, range=0.3..1)
footprint_curve = CSharpScript(footprint=footprint, length=expression, width=expression_2, insetLength=expression_4, insetWidth=expression_5)  # -> out, a; inputs footprint: String, length: Double, width: Double, insetLength: Double, insetWidth: Double
# ---------- footprint_curve: C# ----------
// Grasshopper Script Instance
#region Usings
using System;
using System.Linq;
using System.Collections;
using System.Collections.Generic;
using System.Drawing;

using Rhino;
using Rhino.Geometry;

using Grasshopper;
using Grasshopper.Kernel;
using Grasshopper.Kernel.Data;
using Grasshopper.Kernel.Types;
#endregion

public class Script_Instance : GH_ScriptInstance
{
    #region Notes
    /* 
      Members:
        RhinoDoc RhinoDocument
        GH_Document GrasshopperDocument
        IGH_Component Component
        int Iteration

      Methods (Virtual & overridable):
        Print(string text)
        Print(string format, params object[] args)
        Reflect(object obj)
        Reflect(object obj, string method_name)
    */
    #endregion

private void RunScript(
		string footprint,
		double length,
		double width,
		double insetLength,
		double insetWidth,
		ref object a)
    {
        // Tolerance for boolean operations
        double tol = Rhino.RhinoDoc.ActiveDoc?.ModelAbsoluteTolerance ?? Rhino.RhinoMath.UnsetValue;

        // 1. Create the outer rectangle
        var outer = new Rectangle3d(Plane.WorldXY, width, length).ToNurbsCurve();

        // 2. Prepare result list for footprint curves
        List<Curve> result = new List<Curve>();

        // 3. Compute footprint based on type
        switch (footprint)
        {
            case "Rectangle":
                result.Add(outer);
                break;

            case "L":
                {
                    var notch = new Rectangle3d(Plane.WorldXY, insetWidth, insetLength).ToNurbsCurve();
                    notch.Translate(new Vector3d(width - insetWidth, length - insetLength, 0));
                    var diffs = Curve.CreateBooleanDifference(outer, notch, tol);
                    if (diffs != null) result.AddRange(diffs);
                }
                break;

            case "C":
                {
                    var notch = new Rectangle3d(Plane.WorldXY, insetWidth, insetLength).ToNurbsCurve();
                    notch.Translate(new Vector3d((width - insetWidth) / 2.0, length - insetLength, 0));
                    var diffs = Curve.CreateBooleanDifference(outer, notch, tol);
                    if (diffs != null)
                        result.AddRange(diffs);
                }
                break;

            case "Courtyard":
                {
                    var hole = new Rectangle3d(Plane.WorldXY, insetWidth, insetLength).ToNurbsCurve();
                    hole.Translate(new Vector3d((width - insetWidth) / 2.0, (length - insetLength) / 2.0, 0));
                    var diffs = Curve.CreateBooleanDifference(outer, hole, tol);
                    if (diffs != null)
                        result.AddRange(diffs);
                }
                break;

            default:
                result.Add(outer);
                break;
        }

        // 4. Output handling
        // Preserve both outer and hole for courtyard
        if (footprint == "Courtyard")
        {
            a = result.Count > 0 ? (object)result : null;
            return;
        }

        // For other types, if only one curve, output it
        if (result.Count == 1)
        {
            a = result[0];
            return;
        }

        // If multiple segments, try to join
        if (result.Count > 1)
        {
            var joined = Curve.JoinCurves(result, tol);
            if (joined != null && joined.Length > 0)
            {
                a = joined[0];
                return;
            }
        }

        // Fallback: null if nothing
        a = null;
    }
}
# ---------- end footprint_curve ----------
floor1envelope = CSharpScript(footprintCurve=footprint_curve.a, wallThickness=wall_thickness, floorHeight=expression_3, floorType=floor1type)  # -> out, floorEnvelope; inputs wallThickness: Double, floorHeight: Double, floorType: String
# ---------- floor1envelope: C# ----------
// Grasshopper Script Instance
#region Usings
using System;
using System.Linq;
using System.Collections;
using System.Collections.Generic;
using System.Drawing;

using Rhino;
using Rhino.Geometry;

using Grasshopper;
using Grasshopper.Kernel;
using Grasshopper.Kernel.Data;
using Grasshopper.Kernel.Types;
#endregion

public class Script_Instance : GH_ScriptInstance
{
    #region Notes
    /* 
      Members:
        RhinoDoc RhinoDocument
        GH_Document GrasshopperDocument
        IGH_Component Component
        int Iteration

      Methods (Virtual & overridable):
        Print(string text)
        Print(string format, params object[] args)
        Reflect(object obj)
        Reflect(object obj, string method_name)
    */
    #endregion

    private void RunScript(
		object footprintCurve,
		double wallThickness,
		double floorHeight,
		string floorType,
		ref object floorEnvelope)
    {
        // 1. Cast input to a Rhino curve
        var outer = footprintCurve as Rhino.Geometry.Curve;
        if (outer == null)
        {
            floorEnvelope = null;
            return;
        }

        // 2. Only do work if floorType is "arcade"
        if (!string.Equals(floorType, "arcade", StringComparison.OrdinalIgnoreCase))
        {
            floorEnvelope = null;
            return;
        }

        double tol = RhinoDocument.ModelAbsoluteTolerance;

        // 3. If the input is a polyline that isn't closed, close it
        if (!outer.IsClosed)
        {
            Rhino.Geometry.Polyline pl;
            if (outer.TryGetPolyline(out pl))
            {
                if (!pl.IsClosed) pl.Add(pl[0]);
                outer = new Rhino.Geometry.PolylineCurve(pl);
            }
        }

        // 4. Offset inward by wallThickness
        var inners = outer.Offset(
            Rhino.Geometry.Plane.WorldXY,
            -wallThickness,
            tol,
            Rhino.Geometry.CurveOffsetCornerStyle.Sharp);
        if (inners == null || inners.Length == 0)
        {
            floorEnvelope = null;
            return;
        }
        var inner = inners[0];

        // 5. Ensure the inner curve is closed too
        if (!inner.IsClosed)
        {
            Rhino.Geometry.Polyline pl2;
            if (inner.TryGetPolyline(out pl2))
            {
                if (!pl2.IsClosed) pl2.Add(pl2[0]);
                inner = new Rhino.Geometry.PolylineCurve(pl2);
            }
        }

        // 6. Make a planar Brep ring between outer & inner
        var planar = Rhino.Geometry.Brep.CreatePlanarBreps(
            new Rhino.Geometry.Curve[] { outer, inner },
            tol);
        if (planar == null || planar.Length == 0)
        {
            floorEnvelope = null;
            return;
        }
        var region = planar[0];

        // 7. Build a spine line straight up from the region's centroid
        var bbox = region.GetBoundingBox(true);
        var bottom = bbox.Center;
        var top    = bbox.Center;
        top.Z += floorHeight;
        var spine  = new Rhino.Geometry.LineCurve(bottom, top);

        // 8. Extrude that single planar face along the spine (caps both ends)
        var face      = region.Faces[0];
        var extruded  = face.CreateExtrusion(spine, true);

        floorEnvelope = extruded;  
    }
}
# ---------- end floor1envelope ----------
floor1subtractadd = CSharpScript(
    colWidth=column_width,
    archWidth=arch_width,
    wallThickness=wall_thickness,
    bayCountX=baycountx,
    bayCountY=baycounty,
    colHeight=column_height,
    floorType=floor1type,
    length=expression,
    width=expression_2)  # -> out, a; inputs colWidth: Double, archWidth: Double, wallThickness: Double, bayCountX: Int32, bayCountY: Int32, colHeight: Double, floorType: String
# ---------- floor1subtractadd: C# ----------
#region Usings
using System;
using System.Collections.Generic;
using Rhino;
using Rhino.Geometry;
#endregion

public class Script_Instance : GH_ScriptInstance
{
  private void RunScript(
		double colWidth,
		double archWidth,
		double wallThickness,
		int bayCountX,
		int bayCountY,
		double colHeight,
		string floorType,
		object length,
		object width,
		ref object a)
  {
    var breps = new List<Brep>();
    double tol = RhinoDoc.ActiveDoc?.ModelAbsoluteTolerance ?? 1e-6;

    // Convert inputs
    double widthVal  = ToDouble(width);
    double lengthVal = ToDouble(length);

    if (floorType == "arcade")
    {
      // —— Arcade logic (unchanged) ——
      double extrudeY = -lengthVal;
      double extrudeX =  widthVal;
      double step     = archWidth + colWidth;
      double offset   = wallThickness + colWidth*0.5 + archWidth*0.5;

      // X‐direction
      for (int i = 0; i < bayCountX; i++)
      {
        double cx = offset + i * step;
        var bl   = new Point3d(cx - archWidth/2.0, 0, 0);
        var br   = new Point3d(cx + archWidth/2.0, 0, 0);
        var tl   = new Point3d(cx - archWidth/2.0, 0, colHeight);
        var tr   = new Point3d(cx + archWidth/2.0, 0, colHeight);
        var apex = new Point3d(cx,                   0, colHeight + archWidth/2.0);

        var curves = new List<Curve> {
          new Arc(tl, apex, tr).ToNurbsCurve(),
          new Line(br, tr).ToNurbsCurve(),
          new Line(bl, br).ToNurbsCurve(),
          new Line(tl, bl).ToNurbsCurve()
        };
        var joined = Curve.JoinCurves(curves, tol);
        if (joined != null && joined.Length > 0)
        {
          var prof = joined[0];
          var extr = Extrusion.Create(prof, extrudeY, true);
          if (extr != null) breps.Add(extr.ToBrep(true));
        }
      }

      // Y‐direction
      for (int j = 0; j < bayCountY; j++)
      {
        double cy = offset + j * step;
        var bl   = new Point3d(0, cy - archWidth/2.0, 0);
        var br   = new Point3d(0, cy + archWidth/2.0, 0);
        var tl   = new Point3d(0, cy - archWidth/2.0, colHeight);
        var tr   = new Point3d(0, cy + archWidth/2.0, colHeight);
        var apex = new Point3d(0, cy, colHeight + archWidth/2.0);

        var curves = new List<Curve> {
          new Arc(tl, apex, tr).ToNurbsCurve(),
          new Line(br, tr).ToNurbsCurve(),
          new Line(bl, br).ToNurbsCurve(),
          new Line(tl, bl).ToNurbsCurve()
        };
        var joined = Curve.JoinCurves(curves, tol);
        if (joined != null && joined.Length > 0)
        {
          var prof = joined[0];
          var extr = Extrusion.Create(prof, extrudeX, true);
          if (extr != null) breps.Add(extr.ToBrep(true));
        }
      }
    }
    else if (floorType == "colonnade")
    {
      // —— Colonnade logic (unchanged placement and Tuscan columns) ——
      double radius = wallThickness * 0.5;
      double height = colHeight + archWidth * 0.5 + 0.5;

      // along X
      double xStart = wallThickness * 0.5;
      double xEnd   = widthVal - wallThickness * 0.5;
      double yPos   = wallThickness * 0.5;
      double segX   = (xEnd - xStart) / bayCountX;
      for (int i = 0; i <= bayCountX; i++)
      {
        double x = xStart + segX * i;
        AddTuscanColumn(breps, new Point3d(x, yPos, 0), radius, height, tol);
      }

      // along Y
      double yStart = wallThickness * 0.5;
      double yEnd   = lengthVal - wallThickness * 0.5;
      double xPos   = wallThickness * 0.5;
      double segY   = (yEnd - yStart) / bayCountY;
      for (int j = 0; j <= bayCountY; j++)
      {
        double y = yStart + segY * j;
        AddTuscanColumn(breps, new Point3d(xPos, y, 0), radius, height, tol);
      }
    }
    else if (floorType == "solid")
    {
      // TODO: implement solid building logic
    }

    // —— Final Boolean Union of everything ——  
    Brep[] result;
    try
    {
      result = Brep.CreateBooleanUnion(breps, tol);
    }
    catch
    {
      result = breps.ToArray();
    }

    a = result.Length > 0 ? (object)result : null;
  }

  private void AddTuscanColumn(
      List<Brep> breps,
      Point3d baseCenter,
      double radius,
      double height,
      double tol)
  {
    double baseH  = height * 0.1;
    double capH   = height * 0.1;
    double shaftH = height - baseH - capH;
    double shaftR = radius * 0.8;
    double capR   = radius * 0.9;

    // base
    var baseC = new Circle(new Plane(baseCenter, Vector3d.ZAxis), radius);
    breps.Add(new Cylinder(baseC, baseH).ToBrep(true, true));
    // shaft
    var shaftC = new Circle(
      new Plane(baseCenter + Vector3d.ZAxis * baseH, Vector3d.ZAxis), shaftR);
    breps.Add(new Cylinder(shaftC, shaftH).ToBrep(true, true));
    // capital
    var capC = new Circle(
      new Plane(baseCenter + Vector3d.ZAxis * (baseH + shaftH), Vector3d.ZAxis), capR);
    breps.Add(new Cylinder(capC, capH).ToBrep(true, true));
  }

  private double ToDouble(object o)
  {
    if (o is double d) return d;
    if (o is int    i) return i;
    try { return Convert.ToDouble(o); }
    catch { return 0.0; }
  }
}
# ---------- end floor1subtractadd ----------
correctorientation = CSharpScript(extrudedShape=floor1envelope.floorEnvelope)  # -> out, correctedShape
# ---------- correctorientation: C# ----------
// Grasshopper Script Instance
#region Usings
using System;
using System.Collections.Generic;
using Rhino;
using Rhino.Geometry;
#endregion

public class Script_Instance : GH_ScriptInstance
{
    private void RunScript(object extrudedShape, ref object correctedShape)
    {
        // 1. Cast input to a Brep
        var brep = extrudedShape as Brep;
        if (brep == null)
        {
            correctedShape = null;
            return;
        }

        // 2. Duplicate for modification
        var fixedBrep = brep.DuplicateBrep();
        bool needsFlip = false;
        double tol = RhinoDocument.ModelAbsoluteTolerance;

        // 3. Check each face: if any normal points inside, mark for flip
        foreach (var face in fixedBrep.Faces)
        {
            var amp = AreaMassProperties.Compute(face);
            if (amp == null) continue;

            var center = amp.Centroid;
            var normal = face.NormalAt(face.Domain(0).Mid, face.Domain(1).Mid);
            normal.Unitize();

            var testPoint = center + normal * 0.1;
            if (fixedBrep.IsPointInside(testPoint, tol, false))
            {
                needsFlip = true;
                break;
            }
        }

        // 4. Flip whole Brep if needed
        if (needsFlip)
            fixedBrep.Flip();

        // 5. Output corrected Brep
        correctedShape = fixedBrep;
    }
}
# ---------- end correctorientation ----------
floor1generation = CSharpScript(floorEnvelope=correctorientation.correctedShape, subtractAdd=floor1subtractadd.a, floorType=floor1type)  # -> out, A
# ---------- floor1generation: C# ----------
#region Usings
using System;
using System.Collections;
using System.Collections.Generic;
using Rhino;
using Rhino.Geometry;
#endregion

public class Script_Instance : GH_ScriptInstance
{
    /// <summary>
    /// brepIn: your extruded ring Brep
    /// A:    List of resulting Breps after processing
    /// </summary>
    private void RunScript(
		object floorEnvelope,
		object subtractAdd,
		object floorType,
		ref object A)
    {
        // 1. Extract Brep lists from inputs
        var envList = ExtractBreps(floorEnvelope);
        var subList = ExtractBreps(subtractAdd);

        // we expect exactly one subtract brep for arcade
        Brep subtractBrep = (subList.Count > 0) ? subList[0] : null;

        double tol = RhinoDoc.ActiveDoc?.ModelAbsoluteTolerance ?? RhinoMath.UnsetValue;

        // 2. Union all subtractAdd breps for colonnade case
        Brep[] unionSub;
        try
        {
            unionSub = Brep.CreateBooleanUnion(subList.ToArray(), tol);
        }
        catch
        {
            unionSub = subList.ToArray();
        }

        // 3. Branch by floor1Type
        string typeStr = floorType as string;
        Brep[] result = null;

        if (string.Equals(typeStr, "arcade", StringComparison.OrdinalIgnoreCase))
        {
            // Subtract the single subtractBrep from each envelope
            var diffResults = new List<Brep>();
            foreach (var env in envList)
            {
                Brep[] diffs = null;
                if (subtractBrep != null)
                {
                    try
                    {
                        diffs = Brep.CreateBooleanDifference(
                            new[] { env },
                            new[] { subtractBrep },
                            tol
                        );
                    }
                    catch
                    {
                        // difference failed; leave diffs null
                        diffs = null;
                    }
                }

                // if difference succeeded, take the first; else keep original
                if (diffs != null && diffs.Length > 0)
                    diffResults.Add(diffs[0]);
                else
                    diffResults.Add(env);
            }

            result = diffResults.ToArray();
        }
        else if (string.Equals(typeStr, "colonnade", StringComparison.OrdinalIgnoreCase))
        {
            // Only output the unioned subtractAdd breps
            result = unionSub;
        }
        else
        {
            // Default: return envelope only
            result = envList.ToArray();
        }

        // 4. Output
        A = (result != null && result.Length > 0) ? (object)result : null;
    }

    /// <summary>
    /// Helper: extract Brep list from various input types
    /// </summary>
    private List<Brep> ExtractBreps(object input)
    {
        var breps = new List<Brep>();
        if (input is Brep b)
        {
            breps.Add(b);
        }
        else if (input is Brep[] ba)
        {
            breps.AddRange(ba);
        }
        else if (input is IEnumerable ie)
        {
            foreach (var item in ie)
            {
                if (item is Brep br)
                    breps.Add(br);
            }
        }
        return breps;
    }
}
# ---------- end floor1generation ----------
checkorientation = CSharpScript()  # -> out, report
# ---------- checkorientation: C# ----------
// Grasshopper Script Instance
#region Usings
using System;
using System.Linq;
using Rhino.Geometry;
using Grasshopper.Kernel.Types;
#endregion

public class Script_Instance : GH_ScriptInstance
{
    private void RunScript(object brepInput, ref object report)
    {
        var brep = (brepInput as GH_Brep)?.Value ?? brepInput as Brep;
        if (brep == null)
        {
            report = "Invalid input - provide a Brep";
            return;
        }

        string orientationReport = "";
        int incorrectFaces = 0;
        double tol = RhinoDocument.ModelAbsoluteTolerance;

        foreach (var face in brep.Faces)
        {
            var amp = AreaMassProperties.Compute(face);
            if (amp == null) continue;

            var center = amp.Centroid;
            var normal = face.NormalAt(face.Domain(0).Mid, face.Domain(1).Mid);
            normal.Unitize();

            // Test point slightly offset along normal
            var testPoint = center + normal * 0.1;
            bool isInside = brep.IsPointInside(testPoint, tol, false);

            if (isInside)
            {
                incorrectFaces++;
                orientationReport += $"Face {face.FaceIndex}: Normal points INTO solid (incorrect)\n";
            }
            else
            {
                orientationReport += $"Face {face.FaceIndex}: Normal points OUT (correct)\n";
            }
        }

        report = $"ORIENTATION REPORT:\n" +
                 $"Total faces: {brep.Faces.Count}\n" +
                 $"Incorrect faces: {incorrectFaces}\n\n" +
                 orientationReport;
    }
}
# ---------- end checkorientation ----------
